# Grasshopper definition 170705_force_field_demo.gh (Grasshopper 0.9.76)
# plug-ins: FlexHopper

# ----
# The timer is used for two things:
# 1 - Make the fountain emit new
#       particles at every tick
# 2 - Increase the group index every
#       other iteration to get colored
#       groups
# Reset this recorder every
# once in a while
number_slider = Slider(0.005, range=0..2)
timer = Timer(TimerInterval=5, Target=[fountain, num])  # disabled
num = Number(number_slider)
rec = DataRecorder(num, DataLimit=-10, RecordData=True)
ma = MassAddition(Input=rec)  # -> Result, PartialResults

# ----
# Particle Fountain
number_slider_2 = Slider(100, range=0..100)
pt = Point(Point(-2000, 0, 3000))
X = UnitX(Factor=number_slider_2)
yz = YZPlane(Origin=pt)
fountain = ParticleFountain(
    OriginPlane=yz,
    ParticleCount=Slider(8, range=1..100),
    Diameter=Slider(500, range=0..500),
    Angle=0.5235987861,
    Velocity=X)  # -> Points, Velocities
particles = ParticlesFromPoints(
    Positions=fountain.Points,
    Velocities=fountain.Velocities,
    SelfCollision=Toggle(True),
    IsFluid=Toggle(True),
    GroupIndex=ma.Result)

# ----
# Collision planes
Y = UnitY(Factor=1)
X_2 = UnitX(Factor=1)
Y_2 = UnitY(Factor=1)  # -> expr("x*-1", UnitVector)
X_3 = UnitX(Factor=1)  # -> expr("x*-1", UnitVector)
pt_2 = Point([Point(-2000, 0, 0), Point(0, -1333.333333, 0), Point(2000, 0, 0), Point(0, 1333.333333, 0)])
merge = Merge(Data1=X_2, Data2=Y, Data3=X_3, Data4=Y_2)
xy = XYPlane(Origin=Point(0, 0, 0))
pl = PlaneNormal(Origin=pt_2, ZAxis=merge)
collgeometry = FlexCollisionGeometry(CollisionPlanes=flatten([xy, pl]))

# ----
# Force fields
# Play with them!
number_slider_3 = Slider(0, range=-50..50)
number_slider_4 = Slider(2000, range=0..5000)
number_slider_5 = Slider(2000, range=0..5000)
pt_3 = Point(<point referenced from the Rhino model>)
pt_4 = Point(<point referenced from the Rhino model>)
sph = Sphere(Base=[pt_4, pt_3], Radius=[number_slider_4, number_slider_5])
force_field = ForceField(Positions=pt_3, Radius=number_slider_5, Strength=Slider(0, range=-50..50), LinearFallOff=False, Mode=0)
force_field_2 = ForceField(Positions=pt_4, Radius=number_slider_4, Strength=number_slider_3, LinearFallOff=False, Mode=0)
preview = CustomPreview(Geometry=sph, Shader=ColourSwatch(SwatchColor=RGBA(255, 255, 255, 0)))

scene = FlexScene(Particles=flatten(particles))
opts = FlexSoverOptions(TimeStep=Slider(0.2, range=0..0.3), SubSteps=3, NumIterations=3)
params = FlexParametersFromXmlFile(FilePath="force_field_params.xml")
flex = FlexEngine(
    FlexParams=params,
    FlexCollisionGeometry=collgeometry,
    FlexForceFields=[force_field_2, force_field],
    FlexScene=flatten(scene),
    FlexSolverOptions=opts,
    LockMode=False,
    Reset=Button(),
    Go=Toggle(False))  # -> FlexObject, Information
panel = Panel(flex.Information)
allparts = GetAllParticles(FlexObject=flex.FlexObject, N=1)  # -> Points, Vector

# ----
# Assign color based
# on tree branch index
tstat = TreeStatistics(Tree=allparts.Points)  # -> Paths, Length, Count
range = Range(Domain=Domain(0, 1), Steps=tstat.Count)
hsl = ColourHSL(Alpha=1, Hue=range, Saturation=1, Luminance=0.5)  # -> graft(Colour)

# ----
# Enable us when needed
# we're pretty slow
preview_2 = CustomPreview(Geometry=allparts.Points, Shader=hsl)  # disabled
vdisex = VectorDisplayEx(Point=allparts.Points, Vector=allparts.Vector, Colour=hsl, Width=1)
