# Grasshopper definition 170713_softBodyDemo.gh (Grasshopper 0.9.76)
# plug-ins: MeshEdit Components, FlexHopper

number_slider = Slider(1, range=0..12)
vec = VectorXYZ(XComponent=15, YComponent=0, ZComponent=0)  # -> Vector, Length
mesh = Mesh(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)
demesh = DeconstructMesh(Mesh=mesh)  # -> Vertices, Faces, Colours, Normals
number_slider_2 = Slider(1, range=1..12)
panel = Panel("""1
2
0
1.5
2
0.1
1.5
0.0
0.0""")
pt = ConstructPoint(XCoordinate=0, YCoordinate=0, ZCoordinate=15)
xy = XYPlane(Origin=Point(0, 0, 0))
triangle = MeshTriangle(CornerA=0, CornerB=1, CornerC=2)
move = Move(Geometry=mesh, Motion=vec.Vector)  # -> Geometry, Transform
box = CenterBox(Base=pt, X=number_slider, Y=number_slider, Z=number_slider)
particles = ParticlesFromPoints(Positions=demesh.Vertices)
soft = SoftFromMesh(Meshes=mesh, Velocities=Vector(0, 0, 0), Mass=1, SoftParams=panel)
collgeometry = FlexCollisionGeometry(CollisionPlanes=flatten(xy))
mbox = MeshBox(Base=box, XCount=number_slider_2, YCount=number_slider_2, ZCount=number_slider_2)
series = Series(Start=0, Step=1, Count=104)
soft_2 = SoftFromMesh(Meshes=move.Geometry, Velocities=Vector(0, 0, 0), Mass=1, SoftParams=panel, GroupIndex=1)
tri = Triangulate(Mesh=mbox)  # -> Mesh, Count
shape_matching = ConstraintShapeMatchingConstraint(ParticleIndices=series, Stiffness=Slider(0.017, range=0..1))
weld = WeldMesh(Mesh=tri.Mesh, Angle=3.141592654)
scene = FlexScene(Particles=flatten(particles), Constraints=flatten(shape_matching))
unifynormals = MeshUnifyNormals(Mesh=weld)
panel_2 = Panel(scene)
flex = FlexEngine(FlexCollisionGeometry=collgeometry, FlexScene=flatten(scene), LockMode=False, Reset=Button(), Go=Toggle(True))  # -> FlexObject, Information
allparts = GetAllParticles(FlexObject=flex.FlexObject, N=1)  # -> Points, Vector
allsprings = GetAllSprings(FlexObject=flex.FlexObject, N=1)
