# Grasshopper definition 180211_rigids_with_springs.gh (Grasshopper 0.9.76)
# plug-ins: FlexHopper

number_slider = Slider(34.158, range=1..100)
number_slider_2 = Slider(1000, range=0..1000)
number_slider_3 = Slider(1, range=1..5)
box = CenterBox(Base=PlaneXY(0, 0, 0), X=number_slider, Y=number_slider, Z=number_slider)
dom = ConstructDomain(DomainStart=expr("-x", number_slider_2), DomainEnd=number_slider_2)
mbox = MeshBox(Base=box, XCount=number_slider_3, YCount=number_slider_3, ZCount=number_slider_3)
random = Random(Range=dom, Number=expr("x*6", Slider(1000, range=1..2000)), Seed=2)
tri = Triangulate(Mesh=mbox)  # -> Mesh, Count
partition = PartitionList(List=random, Size=6)
item = ListItem(List=partition, Index=0, Wrap=True)  # -> Item, Item1, Item2, Item3, Item4, Item5
abs = Absolute(Value=item.Item2)
pt = ConstructPoint(XCoordinate=item.Item, YCoordinate=item.Item1, ZCoordinate=expr("x*2", abs))
vec = VectorXYZ(XComponent=item.Item3, YComponent=item.Item4, ZComponent=item.Item5)  # -> Vector, Length
weld = WeldMesh(Mesh=tri.Mesh, Angle=3.141592654)
pl = PlaneNormal(Origin=pt, ZAxis=vec.Vector)
number_slider_4 = Slider(-0.1, range=-2..2)
orient = Orient(Geometry=weld, Source=PlaneXY(0, 0, 0), Target=pl)  # -> flatten(Geometry), Transform
lng = ListLength(List=orient.Geometry)
dom_2 = ConstructDomain(DomainStart=0, DomainEnd=expr("x*8", lng))
random_2 = Random(Range=dom_2, Number=expr("x*2", Slider(4000, range=0..10000)), Seed=2)
int = Integer(random_2)
springs = ConstraintsSprings(SpringPairIndices=int, SpringStiffness=0.1)
parameters = FlexParametersFromValues(
    Gravity=Vector(0, 0, -9.81),
    Radius=Slider(30, range=0..30),
    SolidRestDistance=Slider(30, range=0..30),
    FluidRestDistance=0.1,
    CollisionDistance=0.075,
    ParticleCollisionMargin=0.5,
    ShapeCollisionMargin=0.5,
    MaxSpeed=3.402823466e+38,
    MaxAcceleration=1000,
    DynamicFriction=0,
    StaticFriction=0,
    ParticleFriction=0,
    Restitution=0,
    Adhesion=0,
    SleepThreshold=0,
    ShockPropagation=0,
    Dissipation=0,
    Damping=0,
    Fluid=True,
    Viscosity=0,
    Cohesion=0.025,
    SurfaceTension=0,
    SolidPressure=1,
    FreeSurfaceDrag=0,
    Buoyancy=1,
    PlasticThreshold=0,
    PlasticCreep=0,
    Wind=Vector(0, 0, 0),
    Drag=0,
    Lift=0,
    RelaxationMode=True,
    RelaxationFactor=1)
xy = XYPlane(Origin=Point(0, 0, 0))
rigid = RigidFromMesh(RigidBodyMesh=orient.Geometry, Velocities=Vector(0, 0, 0), Mass=1, Stiffness=1, GroupIndex=0)
collgeometry = FlexCollisionGeometry(CollisionPlanes=flatten(xy))
opts = FlexSolverOptions(TimeStep=0.1, SubSteps=3, NumIterations=3)
scene = FlexScene(RigidBodies=flatten(rigid), LocalConstraints=flatten(springs))
panel = Panel(rigid)
flex = FlexEngine(
    FlexParams=parameters,
    FlexCollisionGeometry=collgeometry,
    FlexScene=flatten(scene),
    FlexSolverOptions=opts,
    LockMode=False,
    Reset=Button(),
    Go=Toggle(False))  # -> FlexObject, Information
allsprings = GetAllSprings(FlexObject=flex.FlexObject, N=1)
rigids = GetRigids(FlexObject=flex.FlexObject, N=0, Deformable=False, Rigids=rigid)  # -> Points, Vector, Meshes
